# Grasshopper definition preparingCityModel.gh (Grasshopper 0.9.76)
# plug-ins: Python Interpreter, LunchBox

path = FilePath("C:\Users\IA\Google Drive\Master Studies\03. TU Delft\09. Graduation\spatio-temporal-analysis\09_Calibration\04_BuildingData\BuildingBase_small_generalized.shp")
panel = Panel(path)
toggle = BooleanToggle(True)
readshapefile = ReadShapefile(shapefile=panel, read=toggle, moveToCenter=toggle)  # -> out, geometry
# ---------- readshapefile: Python ----------
import os
import sys
import System.Text
bodyname = System.Text.Encoding.Default.BodyName
sys.setdefaultencoding(bodyname)

import struct, datetime, decimal, itertools
from struct import unpack
import Rhino

def dbfreader(f):
    """Returns an iterator over records in a Xbase DBF file.

    The first row returned contains the field names.
    The second row contains field specs: (type, size, decimal places).
    Subsequent rows contain the data records.
    If a record is marked as deleted, it is skipped.

    File should be opened for binary reads.

    """
    # See DBF format spec at:
    #     http://www.pgts.com.au/download/public/xbase.htm#DBF_STRUCT

    numrec, lenheader = struct.unpack('<xxxxLH22x', f.read(32))    
    numfields = (lenheader - 33) // 32

    fields = []
    for fieldno in xrange(numfields):
        name, typ, size, deci = struct.unpack('<11sc4xBB14x', f.read(32))
        name = name.replace('\0', '')       # eliminate NULs from string   
        fields.append((name, typ, size, deci))
    yield [field[0] for field in fields]
    yield [tuple(field[1:]) for field in fields]

    terminator = f.read(1)
    assert terminator == '\r'

    fields.insert(0, ('DeletionFlag', 'C', 1, 0))
    fmt = ''.join(['%ds' % fieldinfo[2] for fieldinfo in fields])
    fmtsiz = struct.calcsize(fmt)
    for i in xrange(numrec):
        record = struct.unpack(fmt, f.read(fmtsiz))
        #print record#[:4]
        if record[0] != ' ':
            continue                        # deleted record
        result = []
        for (name, typ, size, deci), value in itertools.izip(fields, record):
            if name == 'DeletionFlag':
                continue
            if typ == "N":
                value = value.replace('\0', '').lstrip()
                if value == '':
                    value = 0
                elif deci:
                    value = decimal.Decimal(value)
                else:
                    value = int(value)
            elif typ == 'D':
                #print type(value[:4]), type(value[4:6]), type(value[6:8])
                try:
                    y, m, d = int(value[:4]), int(value[4:6]), int(value[6:8])
                    value = datetime.date(y, m, d)
                    print value
                except:
                    value = datetime.date(1,1,1)
                    print "We couldn't get a date for a geometry in your dbf"
            elif typ == 'L':
                value = (value in 'YyTt' and 'T') or (value in 'NnFf' and 'F') or '?'
            result.append(value)
        yield result
        
##########################################################################

class ShpFeature(object):
    '''
    This is a base class for each record in a shapefile.
    each record corresponds to one row in the shapefile's dbf table.
    To clarify the distinction between a feature and a record:
    the record is the feature + the dbf data associated with the feature
    the feature is shape (or multi-shape)
    In this class, I attach the dbf data for each record to it's feature.
    '''

    def __init__(self, shpFile, recordNumber):
        self.shpFile = shpFile
        self.recordNumber = recordNumber
        self.shapeType = shpFile.shapeType
        self.dbfData = self.readDbfData()

    def readDbfData(self):
        db = self.shpFile.dbfTable
        dbfData = {}
        for i in range(len(db[0])): # for each column
                dbfData[db[0][i]] = db[self.recordNumber + 2][i]
        return dbfData

    def make3D(self, zVals=None):
        """
        This method will take a list of z values and use them to create a new
        attribute called points3D, which contains 3d points. ESRI shapefiles
        place z values in a separate list form x and y values for each point,
        so this essentially integrates those values to make full 3d points.
        If the number of z values does not match the number of points,
        then this method will not work.
        This method will overwrite the points3d attribute if it already exists.
        """
        # if there's not enough z values for the number of points
        # or not enough points for the number of z values
        if not zVals:
            zVals = [0 for i in range(self.numPoints)]
        if len(zVals) != self.numPoints:
            print "The number of Z values does not correspond to the number of points."
            return
        # clear points3D
        self.points3D = []
        for i in range(len(zVals)):
            z = zVals[i]
            x = self.points[i][0]
            y = self.points[i][1]
            point3d = (x,y,z)
            self.points3D.append(point3d)

    def chopParts(self, partlist, pointlist):
        if type(partlist) == tuple:
            indexSpread = list(partlist)
        elif type(partlist) == list:
            indexSpread = partlist
        else:
            indexSpread = [partlist]
        indexSpread.append(len(pointlist))
        chunks = []
        for i in range(len(indexSpread) - 1):
            chunks.append(pointlist[indexSpread[i]:indexSpread[i+1]])
        return chunks

class ShpPoint(ShpFeature):

    def __init__(self, ShpFile, recordNumber):
        ShpFeature.__init__(self, ShpFile, recordNumber)
        self.parts = [0]
        self.numParts = 1
        self.numPoints = 1
        self.points = [self.shpFile._readPoint()]
        self.x = self.points[0][0]
        self.y = self.points[0][1]
        self.make3D()

class ShpPointM(ShpPoint):
    def __init__(self,ShpFile, recordNumber):

        ShpPoint.__init__(self, ShpFile, recordNumber)

        self.m = self.shpFile._readZ()
        self.make3D()

class ShpPointZ(ShpPoint):
    def __init__(self,ShpFile, recordNumber):

        ShpPoint.__init__(self, ShpFile, recordNumber)

        self.z = self.shpFile._readZ()
        self.m = self.shpFile._readZ()
        self.make3D([self.z])

class ShpMultiPoint(ShpFeature):

    def __init__(self,ShpFile, recordNumber):

        ShpFeature.__init__(self, ShpFile, recordNumber)
        self.parts[0]
        self.numParts = 1
        self.boundingBox = self.shpFile._readBoundingBox()
        self.numPoints = self.shpFile._readNumPoints()
        self.points = self.shpFile._readPoints(self.numPoints)
        self.make3D()

class ShpMultiPointM(ShpMultiPoint):

    def __init__(self,ShpFile, recordNumber):

        ShpMultiPoint.__init__(self, ShpFile, recordNumber)
        self.mBounds = self.shpFile._readZBounds()
        self.mArray = self.shpFile._readZArray(self.numPoints)
        self.make3D()

class ShpMultiPointZ(ShpMultiPoint):

    def __init__(self,ShpFile, recordNumber):

        ShpMultiPoint.__init__(self, ShpFile, recordNumber)
        self.zBounds = self.shpFile._readZBounds()
        self.zArray = self.shpFile._readZArray(self.numPoints)
        self.mBounds = self.shpFile._readZBounds()
        self.mArray = self.shpFile._readZArray(self.numPoints)
        self.make3D(self.zArray)

class ShpPolyLine(ShpFeature):

    def __init__(self,ShpFile, recordNumber):

        ShpFeature.__init__(self, ShpFile, recordNumber)

        self.boundingBox = self.shpFile._readBoundingBox()
        self.numParts = self.shpFile._readNumParts()
        self.numPoints = self.shpFile._readNumPoints()
        self.parts = self.shpFile._readParts(self.numParts)
        self.points = self.shpFile._readPoints(self.numPoints)
        self.make3D()

class ShpPolyLineM(ShpPolyLine):

    def __init__(self,ShpFile, recordNumber):

        ShpPolyLine.__init__(self, ShpFile, recordNumber)

        self.mBounds = self.shpFile._readZBounds()
        self.mArray = self.shpFile._readZArray(self.numPoints)
        self.make3D()

class ShpPolyLineZ(ShpPolyLine):

    def __init__(self,ShpFile, recordNumber):

        ShpPolyLine.__init__(self, ShpFile, recordNumber)

        self.zBounds = self.shpFile._readZBounds()
        self.zArray = self.shpFile._readZArray(self.numPoints)
        self.mBounds = self.shpFile._readZBounds()
        self.mArray = self.shpFile._readZArray(self.numPoints)
        self.make3D(self.zArray)

class ShpPolygon(ShpFeature):

    def __init__(self,ShpFile, recordNumber):

        ShpFeature.__init__(self, ShpFile, recordNumber)

        self.boundingBox = self.shpFile._readBoundingBox()
        self.numParts = self.shpFile._readNumParts()
        self.numPoints = self.shpFile._readNumPoints()
        self.parts = self.shpFile._readParts(self.numParts)
        self.points = self.shpFile._readPoints(self.numPoints)
        self.make3D()

class ShpPolygonM(ShpPolygon):

    def __init__(self,ShpFile, recordNumber):

        ShpPolygon.__init__(self, ShpFile, recordNumber)

        self.mBounds = self.shpFile._readZBounds()
        self.mArray = self.shpFile._readZArray(self.numPoints)
        self.make3D()

class ShpPolygonZ(ShpPolygon):

    def __init__(self,ShpFile, recordNumber):

        ShpPolygon.__init__(self, ShpFile, recordNumber)

        self.zBounds = self.shpFile._readZBounds()
        self.zArray = self.shpFile._readZArray(self.numPoints)
        self.mBounds = self.shpFile._readZBounds()
        self.mArray = self.shpFile._readZArray(self.numPoints)
        self.make3D(self.zArray)

class ShpMultiPatch(ShpFeature):

    def __init__(self, ShpFile, recordNumber):

        ShpFeature.__init__(self, ShpFile, recordNumber)

        self.boundingBox = self.shpFile._readBoundingBox()
        self.numParts = self.shpFile._readNumParts()
        self.numPoints = self.shpFile._readNumPoints()
        self.parts = self.shpFile._readParts(self.numParts)
        self.partTypes = self.shpFile._readParts(self.numParts)
        self.points = self.shpFile._readPoints(self.numPoints)
        self.zBounds = self.shpFile._readZBounds()
        self.zArray = self.shpFile._readZArray(self.numPoints)
        self.mBounds = self.shpFile._readZBounds()
        self.mArray = self.shpFile._readZArray(self.numPoints)
        self.make3D(self.zArray)
        #self.points = [self.shpFile._readPoint()]

##################################################

def readAndUnpack(type, data):
    if data=='': return data
    return unpack(type, data)[0]

shapeTypeDict = {
                 0:'Null Shape',
                 1:'Point',
                 3:'PolyLine',
                 5:'Polygon',
                 8:'MultiPoint',
                 11:'PointZ',
                 13:'PolyLineZ',
                 15:'PolygonZ',
                 18:'MultiPointZ',
                 21:'PointM',
                 23:'PolyLineM',
                 25:'PolygonM',
                 28:'MultiPointM',
                 31:'MultiPatch'
                 }

classTypeDict = {
                'Point':ShpPoint,
                'PointM':ShpPointM,
                'PointZ':ShpPointZ,
                'MultiPoint':ShpMultiPoint,
                'MultiPointM':ShpMultiPointM,
                'MultiPointZ':ShpMultiPointZ,
                'PolyLine':ShpPolyLine,
                'PolyLineM':ShpPolyLineM,
                'PolyLineZ':ShpPolyLineZ,
                'Polygon':ShpPolygon,
                'PolygonM':ShpPolygonM,
                'PolygonZ':ShpPolygonZ,
                'MultiPatch':ShpMultiPatch
                }


class ShpFile(object):
    '''
This class is instantiated using the file path to a shapefile (must contain the .shp file extension), and as soon as it is instantiated, it reads the entire shapefile.
Once instantiated, it contains objects for each feature based on shape type (the objects are accessible using the
.records attribute), and allows access to the shapefile data at multiple levels.
'''

    def __init__(self,filePath):
        self.filePath = filePath
        self.proj = self._readProjText()
        self.dbfTable = self._readDbfTable()
        self.f = open(self.filePath, 'rb')
        header = self._readFileHeader()
        self.shapeType = header[0]
        self.boundingBox = header[1]
        self.records = self._readRecords()
        self.f.close()

    def _readBoundingBox(self):
        xMin = readAndUnpack('d', self.f.read(8))
        yMin = readAndUnpack('d', self.f.read(8))
        xMax = readAndUnpack('d', self.f.read(8))
        yMax = readAndUnpack('d', self.f.read(8))
        bbox = (xMin, yMin, xMax, yMax)
        return bbox

    def _readProjText(self):
        projPath = self.filePath[0:-4] + '.prj'
        f = open(projPath, 'r')
        s = f.read()
        return s


    def _readFileHeader(self):
        self.f.seek(32)
        shapeKey = readAndUnpack('i', self.f.read(4))
        shapeType = shapeTypeDict[shapeKey]
        boundingBox = self._readBoundingBox()
        return (shapeType, boundingBox)

    def _readPoint(self):
        x = readAndUnpack('d', self.f.read(8))
        y = readAndUnpack('d', self.f.read(8))
        return (x,y)

    def _readNumParts(self):
        return readAndUnpack('i', self.f.read(4))

    def _readNumPoints(self):
        return readAndUnpack('i', self.f.read(4))

    def _readParts(self, numParts):
        partIndices = []
        for i in range(numParts):
            partIndex = readAndUnpack('i', self.f.read(4))
            partIndices.append(partIndex)
        return partIndices

    def _readPoints(self, numPoints):
        points = []
        # I removed a short chunk of code here
        # that was used to remove any two identical
        # consecutive points. Such a check is only relevant if
        # each part is being checked separately, otherwise
        # a part that begins where the other left off would be
        # messed up.
        for i in range(numPoints):
            point = self._readPoint()
            points.append(point)
        return points

    def _readZ(self):
        z = readAndUnpack('d', self.f.read(8))
        return z

    def _readZBounds(self):
        zMin = self._readZ()
        zMax = self._readZ()
        return (zMin,zMax)

    def _readZArray(self, numPoints):
        zArray = []
        for i in range(numPoints):
            z = self._readZ()
            zArray.append(z)
        return zArray

    def setZfield(self, fieldKey=None, zValue=0.0):
        # this method will erase any existing
        # z data of the geometry
        # and will replace it with values
        # from the field designated
        # by the fieldKey
        zValue = 0.0
        for record in self.records:
            if fieldKey != None:
                try:
                    zValue = float(record.dbfData[fieldKey])
                except:
                    print 'There is no field by that name in the table'
                    return
            zArray = []
            for each in range(record.numPoints):
                zArray.append(zValue)
            record.make3D(zArray)

    def _readDbfTable(self):
        dbfFile = self.filePath[0:-4] + '.dbf'
        dbf = open(dbfFile, 'rb')
        db = list(dbfreader(dbf))
        dbf.close()
        return db

    def _readRecords(self):
        records = []
        self.f.seek(100)
        iterator = 0
        while True:
            record = self._readFeature(iterator)
            if record == False:
                    break
            records.append(record)
            iterator += 1
        return records

    def _readFeature(self, iterator):
        # the next 12 bytes are simply passed over, though they contain:
        # a record number: which doesn't seem to correspond to the dbf
        # a content length integer
        # a shapeType integer, which is never different form the shapeType of the file
        read = self.f.read(12)
        if read == '':
                # signifies end of shapefile
                return False
        else:
            # get shapeType and creates appropriate feature
            feature = classTypeDict[self.shapeType](self,iterator)
            return feature

##################################################

def addUserStrings(feature, geom):
    data = feature.dbfData
    for k in data:
        geom.SetUserString(k, str(data[k]))
    return geom

def tVect(geom, vector):
    geom.Translate(vector)
    geom.SetUserString('TranslationVector', str(vector) )
    return geom

def transVectorFromBBox(shpFile):
    """Uses the bounding box of a shapefile to make a vector moving Rhino geometry to the origin. The translation vector
    can also be stored as a user string the Rhino geometry, for later conversion back into geospatial data."""
    b = shpFile.boundingBox
    originalCenterPoint = ((b[0]+b[2])/2, (b[1]+b[3])/2, 0.0)
    translationVectr = Rhino.Geometry.Vector3d((b[0]+b[2])/-2.0, (b[1]+b[3])/-2.0, 0.0)
    return translationVectr

def chop(indices, someList):
    for i in range(len(indices)-1):
        idx1, idx2 = indices[i], indices[i+1]
        yield someList[idx1:idx2]

def chopPoints( feature ):
    if feature.numParts > 1:
        return [p for p in chop(feature.parts, feature.points3D)]
    else:
        return [feature.points3D]

def shpToPoints( feature, translationVector=None ):
    # You can't set user strings to Point3d so for now lets skip it.
    #points = [addUserStrings(feature, Rhino.Geometry.Point3d(*p)) for p in feature.points3D]
    points = [Rhino.Geometry.Point3d(p[0],p[1],p[2]) for p in feature.points3D]
    if translationVector:
        points = [p.Add(p, translationVector) for p in points]
    return points

def shpToCurve( feature, translationVector=None, degree=1):
    parts = chopPoints( feature )
    crvs = []
    for part in parts:
        points = []
        for pt in part:
            rhPoint = Rhino.Geometry.Point3d( *pt )
            points.append( rhPoint )
        crv = Rhino.Geometry.Curve.CreateControlPointCurve( points, degree )
        if translationVector:
            crv = tVect(crv, translationVector )
        crvs.append( addUserStrings(feature, crv) )
    return crvs

def shpToMesh( multiPatchFeature, translationVector=None ):
    m = multiPatchFeature
    parts = chopPoints(m)
    mesh = Rhino.Geometry.Mesh()
    for i, points in enumerate(parts):
        if m.partTypes[i] == 0: # it's a a triangle strip
            submesh = Rhino.Geometry.Mesh()
            for j, pt in enumerate(points): # build vertices
                rhPoint = Rhino.Geometry.Point3d(*pt)
                submesh.Vertices.Add(rhPoint)
            for n in range(len(points)-1):
                submesh.Faces.AddFace(n, n +1, n +2 )
            submesh.Normals.ComputeNormals()
            submesh.Compact()
            mesh.Append(submesh)
        else: # it's some other geometry
            return 'This geometry type is not yet supported, sorry.'
    mesh.UnifyNormals()
    mesh.Normals.ComputeNormals()
    mesh.Compact() # mesh all fresh and ready!
    if translationVector:
        mesh = tVect( mesh, translationVector)
    return [ addUserStrings(m, mesh) ]



translationDict = {
                   'Point':shpToPoints,
                   'Polygon':shpToCurve,
                   'PolyLine':shpToCurve,
                   'PolyLineZ':shpToCurve,
                   'PolygonZ':shpToCurve,
                   'MultiPatch':shpToMesh
                   }

def ShpFileToRhino( filepath, zero=True, tVect=None ):
    shpfile = ShpFile( filepath )
    if zero:
        tVect = transVectorFromBBox( shpfile )
    records = shpfile.records
    geoms = []
    for r in records:
        geoms.extend( translationDict[ shpfile.shapeType ]( r, tVect ) )
    return geoms

##################################################

if read:
    if shapefile:
        if not os.path.exists(shapefile):
            print 'The shapefile you gave me does not exist.\nDouble check the path: "%s"' % shapefile
        # import stuff
        out = ShpFileToRhino( shapefile, moveToCenter )
        print out
        geometry = out
    else:
        print 'no shapefile supplied'
# ---------- end readshapefile ----------
shpextractuserstrings = SHPExtractUserStrings(geometry=readshapefile.geometry)  # -> out, Attributes, Values; inputs geometry: GeometryBase
# ---------- shpextractuserstrings: Python ----------
if geometry:
    data = geometry.GetUserStrings()
    d = {}
    k = []
    v = []
    for u in data:
        k.append(u)
        d[u] = data[u]
        v.append(d[u])
    U = d
    Attributes = k
    Values = v
# ---------- end shpextractuserstrings ----------
item = ListItem(List=shpextractuserstrings.Values, Index=Slider(17, range=0..20), Wrap=True)  # -> flatten(Item)
item_2 = ListItem(List=shpextractuserstrings.Values, Index=Slider(3, range=0..15), Wrap=True)  # -> flatten(Item)
vec = VectorXYZ(XComponent=0, YComponent=0, ZComponent=item)  # -> Vector, Length
boundary = BoundarySurfaces(Edges=readshapefile.geometry)

honeybee = Honeybee_Honeybee()  # -> Vviiiiiiiiiizzz; plug-in component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
ladybug = Ladybug_Ladybug()  # -> Vviiiiiiiiiizzz; plug-in component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

extr = Extrude(Base=boundary, Direction=vec.Vector)
preview = CustomPreview(
    Geometry=extr,
    Shader={ambient=RGB(0, 0, 0), diffuse=RGB(255, 105, 180), emission=RGB(76, 32, 54), shine=0.5, specular=RGB(255, 255, 255), transparency=0})  # disabled
intersectmass = Honeybee_IntersectMasses(bldgMassesBefore=flatten(extr))  # -> bldgMassesAfter; plug-in component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
mass2zone = Honeybee_Masses2Zones(zoneMasses=flatten(intersectmass), zoneNames=item_2, maxRoofAngle=30, createHBZones=Toggle(True))  # -> readMe, HBZones; plug-in component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
labelzones = Honeybee_LabelZones(HBZones=flatten(mass2zone.HBZones))  # -> labelBasePts, brepTxtLabels, zoneWireFrames; disabled; plug-in component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
preview_2 = CustomPreview(
    Geometry=labelzones.brepTxtLabels,
    Shader={ambient=RGB(0, 0, 0), diffuse=RGB(255, 105, 180), emission=RGB(76, 32, 54), shine=0.5, specular=RGB(255, 255, 255), transparency=0})  # disabled
solveadjc = Honeybee_SolveAdjacencies(HBZones=flatten(mass2zone.HBZones), removeCurrentAdjc=False, findAdjc=Toggle(True))  # -> readMe, HBZonesWADJ; plug-in component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
volume = Volume(Geometry=mass2zone.HBZones)  # -> Volume, Centroid; disabled
decomposebytype = Honeybee_DecomposeBasedOnType(HBZone=solveadjc.HBZonesWADJ)  # -> walls, interiorWalls, airWalls, windows, interiorWindows, skylights, roofs, ceilings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; plug-in component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

path_2 = FilePath("C:\Users\IA\Google Drive\Master Studies\03. TU Delft\09. Graduation\spatio-temporal-analysis\08_Archetype\08_ArchClassification\BuildingID.xlsx")
panel_2 = Panel(path_2)
excelwrite = ExcelWrite(
    WriteExcelData=Toggle(False),
    WorkbookPath=panel_2,
    WorksheetName="BuildingID_fromRhino",
    ColumnHeadings="BuildingID",
    Data=item_2,
    ClearSheet=False)

merge = Merge(
    Data1=decomposebytype.walls,
    Data2=decomposebytype.roofs,
    Data3=decomposebytype.groundFloors,
    Data4=decomposebytype.floors)  # -> simplify(Result)
merge_2 = Merge(Data1=decomposebytype.floors, Data2=decomposebytype.groundFloors)

rec = Rectangle({Plane=PlaneXY(-578.5024187, -425.2754482, 0), Size=Domain2(u=0..1132.748113, v=0..842.1919058)})
brep = Brep(rec)
project = Project(Geometry=flatten(merge_2), Plane=brep)  # -> Geometry, Transform
Z = UnitZ(Factor=1)
extr_2 = Extrude(Base=brep, Direction=Z)
Z_2 = UnitZ(Factor=1)
extr_3 = Extrude(Base=project.Geometry, Direction=Z_2)
sunion = SolidUnion(Breps=extr_3)
sdiff = SolidDifference(BrepsA=extr_2, BrepsB=sunion)
project_2 = Project(Geometry=flatten(sdiff), Plane=brep)  # -> Geometry, Transform

join = BrepJoin(Breps=project_2.Geometry)  # -> Breps, Closed
split = SplitList(List=join.Breps, Index=1)  # -> MainGround, IsolatedGround
debrep = DeconstructBrep(Brep=split.IsolatedGround)  # -> simplify(Faces), Edges, Vertices
debrep_2 = DeconstructBrep(Brep=split.MainGround)  # -> Faces, Edges, Vertices
rev = ReverseList(List=debrep.Faces)
flip = Flip(Surface=rev)  # -> Surface, Result
item_3 = ListItem(List=debrep_2.Faces, Index=0, Wrap=True)
item_4 = ListItem(List=flip.Surface, Index=0, Wrap=True)
merge_3 = Merge(Data1=item_3, Data2=item_4)  # -> flatten(Result)
ground = Text("GROUND")
flip_2 = Flip(Surface=merge_3)  # -> Surface, Result

geo = Geometry(merge)
layername = Data(item_2)
buildings = Geometry(geo)
graft = GraftTree(Tree=layername, IncludeEmptyLists=True, IncludeNullItems=True)  # -> simplify(Tree)
join_2 = BrepJoin(Breps=buildings)  # -> Breps, Closed

bake = ObjectBake(
    BakeToggle=Toggle(False),
    GeometryObjects=join_2.Breps,
    Layer=graft,
    ObjectName=graft,
    ObjectColor=RGB(79, 79, 79),
    LayerColor=RGB(255, 255, 255))
bake_2 = ObjectBake(
    BakeToggle=Toggle(False),
    GeometryObjects=flip_2.Surface,
    Layer=ground,
    ObjectName=ground,
    ObjectColor=RGB(252, 239, 202),
    LayerColor=RGB(255, 255, 255))
data = Data(volume.Volume)
merge_4 = Merge(Data1=decomposebytype.walls, Data2=decomposebytype.roofs)  # -> simplify(Result)

area = Area(Geometry=merge_4)  # -> Area, Centroid
ma = MassAddition(Input=area.Area)  # -> Result, PartialResults
division = Division(A=flatten(ma.Result), B=data)  # -> simplify(Result)

pow = Power(A=data, B=0.6666666667)
multiplication = Multiplication(A=pow, B=6)
division_2 = Division(A=flatten(multiplication), B=flatten(ma.Result))  # -> simplify(Result)

rc = Data(division_2)
data_2 = Data(division)

path_3 = FilePath("C:\Users\IA\Google Drive\Master Studies\03. TU Delft\09. Graduation\spatio-temporal-analysis\08_Archetype\08_ArchClassification\RCratio.xlsx")
panel_3 = Panel(path_3)
excelwrite_2 = ExcelWrite(
    WriteExcelData=Toggle(False),
    WorkbookPath=panel_3,
    WorksheetName="RC_fromRhino",
    ColumnHeadings="RC",
    Data=rc,
    ClearSheet=False)

path_4 = FilePath("C:\Users\IA\Google Drive\Master Studies\03. TU Delft\09. Graduation\spatio-temporal-analysis\08_Archetype\08_ArchClassification\SVratio.xlsx")
panel_4 = Panel(path_4)
excelwrite_3 = ExcelWrite(
    WriteExcelData=Toggle(False),
    WorkbookPath=panel_4,
    WorksheetName="SV_fromRhino",
    ColumnHeadings="SV",
    Data=data_2,
    ClearSheet=False)

geo_2 = Geometry(mass2zone.HBZones)
gradient = Gradient(
    LowerLimit=0,
    UpperLimit=Slider(2, range=0..10),
    Parameter=division,
    stops=[0: RGB(0, 128, 0), 0.531: RGB(255, 255, 0), 1: RGB(255, 0, 0)])

larger = LargerThan(FirstNumber=division, SecondNumber=Slider(0.27, range=0..1))  # -> LargerThan, OrEqualTo
smaller = SmallerThan(FirstNumber=division, SecondNumber=Slider(0.52, range=0..1))  # -> SmallerThan, OrEqualTo
and = GateAnd(A=larger.LargerThan, B=smaller.OrEqualTo)
cull = CullPattern(List=geo_2, CullPattern=and)
col = Colour(RGB(24, 155, 242))

larger_2 = LargerThan(FirstNumber=division, SecondNumber=Slider(0.51, range=0..1))  # -> LargerThan, OrEqualTo
smaller_2 = SmallerThan(FirstNumber=division, SecondNumber=Slider(0.6, range=0..1))  # -> SmallerThan, OrEqualTo
and_2 = GateAnd(A=larger_2.LargerThan, B=smaller_2.OrEqualTo)
cull_2 = CullPattern(List=geo_2, CullPattern=and_2)
col_2 = Colour(RGB(174, 242, 39))

larger_3 = LargerThan(FirstNumber=division, SecondNumber=Slider(0.58, range=0..1))  # -> LargerThan, OrEqualTo
cull_3 = CullPattern(List=geo_2, CullPattern=larger_3.LargerThan)
col_3 = Colour(RGB(242, 24, 24))

gradient_2 = Gradient(
    LowerLimit=0,
    UpperLimit=Slider(3, range=0..10),
    Parameter=division_2,
    stops=[0: RGB(234, 38, 0), 0.398: RGB(234, 126, 0), 0.599: RGB(254, 244, 84), 0.823: RGB(173, 203, 249), 1: RGB(75, 107, 169)])

smaller_3 = SmallerThan(FirstNumber=division, SecondNumber=Slider(0.27, range=0..1))  # -> SmallerThan, OrEqualTo
cull_4 = CullPattern(List=geo_2, CullPattern=smaller_3.OrEqualTo)
col_4 = Colour(RGB(70, 176, 127))

bar_graph = BarGraph(rc, BarColor=RGB(255, 0, 90))
bar_graph_2 = BarGraph(data_2, BarColor=RGB(255, 0, 90))
preview_3 = CustomPreview(Geometry=geo_2, Shader=gradient)
preview_4 = CustomPreview(Geometry=geo_2, Shader=gradient_2)
preview_5 = CustomPreview(Geometry=cull_4, Shader=col_4)
preview_6 = CustomPreview(Geometry=cull, Shader=col)
preview_7 = CustomPreview(Geometry=cull_2, Shader=col_2)
preview_8 = CustomPreview(Geometry=cull_3, Shader=col_3)

cull_5 = CullPattern(List=geo, CullPattern=simplify(graft(and)))  # disabled
cull_6 = CullPattern(List=geo, CullPattern=simplify(graft(and_2)))  # disabled

cull_7 = CullPattern(List=geo, CullPattern=simplify(graft(smaller_3.OrEqualTo)))  # disabled
preview_9 = CustomPreview(
    Geometry=cull_7,
    Shader={ambient=RGB(0, 0, 0), diffuse=RGB(255, 105, 180), emission=RGB(76, 32, 54), shine=0.5, specular=RGB(255, 255, 255), transparency=0})  # disabled
preview_10 = CustomPreview(
    Geometry=cull_5,
    Shader={ambient=RGB(0, 0, 0), diffuse=RGB(255, 105, 180), emission=RGB(76, 32, 54), shine=0.5, specular=RGB(255, 255, 255), transparency=0})  # disabled
preview_11 = CustomPreview(
    Geometry=cull_6,
    Shader={ambient=RGB(0, 0, 0), diffuse=RGB(255, 105, 180), emission=RGB(76, 32, 54), shine=0.5, specular=RGB(255, 255, 255), transparency=0})  # disabled
